vi "FM_Modulator.gvi"   [LabVIEW Communications System Design Suite 2.0.1]
panel controls:
  "frequency deviation": f64
  "message signal": f64[]
  "A_c": f64
panel indicators:
  "Theta": f64[]
uses:
  NI::Analysis::Generation::Sine Waveform.gvi
  NI::Analysis::IntegralDifferentiation::Integral x(t).gvi
diagram:
  Property Node()
  call "Sine Waveform.gvi"() -> (sine wave=w1)
  Waveform Multiply($A_c, w1)
  call "Integral x(t).gvi"()
  call "Sine Waveform.gvi"(phase in=90) -> (sine wave=w2)
  Waveform Multiply($A_c, w2)
  Multiply($"frequency deviation", 6.28) -> w3
  call "Integral x(t).gvi"(x(t)=$"message signal") -> (integral x(t)=w4)
  Multiply(w3, w4) -> w5
  $Theta <- w5
