vi "CLT.gvi"   [LabVIEW Communications System Design Suite 2.0.1]
panel controls:
  "Wait_control": u32
  "number of bins": i32 = 10
  "Loop_var1": i32
  "Loop_var2": i32
  "Stop_at_iteration": i32
panel indicators:
  "histogram": T1
types:
  T1 = cluster{"x values": f64[], "histogram h(x)": f64[]}
uses:
  NI::Analysis::Statistics::Histogram (single-shot)(DBL Array).gvi
diagram:
  s1 = f64[] []  # shift register
  while (iteration -> i1) {
    Wait(time to wait=$Wait_control)
    w1 = $Loop_var1
    for (N = w1) {
      w3 = $Loop_var2
      for (N = w3) {
        Random Number() -> (number (0 to 1)=w5)
        Subtract(x=w5, y=0.5) -> w6
        append w6 to w4
      }
      append w4 to w2
    }
    Multiply(w3, w1) -> w7
    Add Array Elements(numeric array=w2) -> (sum=w8)
    Divide(x=w8, y=w7) -> w9
    Insert Into Array(inArray=s1, index0=i1, new=w9) -> w10
    call "Histogram (single-shot)(DBL Array).gvi"(signal=w10, number of bins=$"number of bins") -> (histogram=w11)
    $histogram <- w11
    Is Equal(x=i1, y=$Stop_at_iteration) -> w12
    next s1 = w10
    stop if w12
  }
